vi "Example vi 5.gvi"   [LabVIEW NXG 5.0.0]
panel indicators:
  "tables": string[]
uses:
  DatabaseConnectivity::DB Tools Open Connec (String).gvi
  DatabaseConnectivity::DB Tools List Tables.gvi
  DatabaseConnectivity::DB Tools Close Connection.gvi
diagram:
  call "DB Tools Open Connec (String).gvi"(connection information="DSN=TestDSN", userID="Admin") -> (connection reference out=w1, error out=w2)
  call "DB Tools List Tables.gvi"(connection reference=w1, error in=w2) -> (connection reference out=w3, tables=w4, error out=w5)
  call "DB Tools Close Connection.gvi"(connection reference=w3, error in=w5)
  $tables <- w4
