vi "File Handler.gvi"   [LabVIEW NXG 5.0.0]
inputs:
  "Error In": error
  "Misc Data Mega Cluster In": "Misc Mega Cluster.gtype"
  "JV Measurements Mega Cluster In": "JV Measurements Mega Cluster.gtype" = {"Cell Array"=[], "JV Full Data Array"=[], "JV Curve Parameters"={1, -0.2, FALSE, 0.1, TRUE, 1, 8e-06, 1000, 100, 3, 0.5, 1, 0, 0}, "Cell Selector"={FALSE, FALSE, FALSE, FALSE, FALSE, FALSE, FALSE, FALSE, FALSE, FALSE, FALSE, FALSE, FALSE, FALSE, FALSE, FALSE, FALSE, FALSE, FALSE, FALSE, FALSE, FALSE, FALSE, FALSE, FALSE, FALSE, FALSE, FALSE, FALSE, FALSE}}
  "Measurement File Type": "Measurement File Type.gtype" = "TXT JV Curve"
outputs:
  "Error Out": error
types:
  "Measurement File Type.gtype" = enum{"TXT JV Curve", "TXT Parameters", "Excel", "Origin", "Power Point"}
  "Full Reference Cluster.gtype" = cluster{"Status Report": "Status Report.gtype", "Path Cluster": "Path Cluster.gtype", "Sample Naming Cluster": "Sample Naming Cluster.gtype", "Acquisition Parameters": "Acquisition Parameters.gtype", "Live Progress Cluster": "Live Progress.gtype", "Sample Extra Information": "Sample extra imformation.gtype"}
  "Misc Mega Cluster.gtype" = cluster{"Full Reference Cluster": "Full Reference Cluster.gtype"}
  "Cell Selector.gtype" = enum{"L.01", "L.02", "L.03", "L.04", "L.05", "L.06", "L.07", "L.08", "L.09", "L.10", "L.11", "L.12", "R.01", "R.02", "R.03", "R.04", "R.05", "R.06", "R.07", "R.08", "R.09", "R.10", "R.11", "R.12", "Custom"}
  "JV Data Cluster.gtype" = cluster{"Voltage (V)": f64[], "Current (A)": f64[], "Current Density (A/m^2)": f64[], "Cell Area (m^2)": f64, "Illumination (W/m^2)": f64, "Voc (V)": f64, "Jsc (A/m^2)": f64, "FF (%)": f64, "Rsh (Ω · m^2)": f64, "Rs (Ω · m^2)": f64, "Eff (%)": f64, "Measured Cell": "Cell Selector.gtype", "No Multiplexer": bool}
  "JV Scan Mode.gtype" = enum{"Rough", "Normal", "Accurate", "Smart", "Custom"}
  "JV Curve Parameters.gtype" = cluster{"Cell Parameters": "Cell Parameters.gtype", "Measurement Precision": "Accuracy Parameters.gtype", "JV Scan Mode": "JV Scan Mode.gtype"}
  "JV Measurements Mega Cluster.gtype" = cluster{"Cell Array": "Cell Selector.gtype"[], "JV Full Data Array": "JV Data Cluster.gtype"[], "JV Curve Parameters": "JV Curve Parameters.gtype", "Cell Selector": "Cell Selector.gtype"}
uses:
  Pika IV Characterization NXG::Main Functions::File Handling::Path Generation::Filetype Folder Path Generator.gvi
  Pika IV Characterization NXG::Main Functions::File Handling::Path Generation::Single File Path Generation.gvi
  Pika IV Characterization NXG::Main Functions::File Handling::JV Data Adapter.gvi
  Pika IV Characterization NXG::Main Functions::File Handling::Single JV Curve Header Generator.gvi
  Pika IV Characterization NXG::Main Functions::File Handling::Path Generation::Full Data File Generator.gvi
  Pika IV Characterization NXG::Side Functions::Path Manipulation::Path Already Exists prompt.gvi
  Pika IV Characterization NXG::Main Functions::File Handling::Low Level::Single File Save.gvi
diagram:
  case ($"Error In") {
    frame Error, Default {
      w1 = $"Error In"
    }
    frame No Error {
      call "Filetype Folder Path Generator.gvi"(Misc Data Mega Cluster In=$"Misc Data Mega Cluster In", Error In=$"Error In", Measurement File Type=$"Measurement File Type") -> (Folder to save data=w2, File Name Cluster Out=w3, Error Out=w4)
      case ($"Measurement File Type") {
        frame "TXT JV Curve", Default {
          Property Node(instance in=$"JV Measurements Mega Cluster In") -> ("JV Full Data Array"=w5)
          s1 = w4  # shift register
          for {
            w6 = each element of w5
            call "Single File Path Generation.gvi"(Folder To Save Data=w2, File Name Cluster In=w3, JV Data Cluster In=w6, Error In=s1, Measurement File Type=$"Measurement File Type") -> (Full File Path=w7, Error Out=w8)
            call "JV Data Adapter.gvi"(Single JV Data Cluster In=w6, Error In=w8, Measurement File Type=$"Measurement File Type") -> (Formatted Data Array=w9, Error Out=w10)
            call "Single JV Curve Header Generator.gvi"(JV Data Cluster In=w6, Error In=w10) -> (Single JV Curve Header=w11, Error Out=w12)
            call "Full Data File Generator.gvi"(Variable Header Info=w11, Data Array To Save=w9, Error In=w12, Measurement File Type=$"Measurement File Type") -> (Full Data Spreadsheet=w13, Error Out=w14)
            call "Path Already Exists prompt.gvi"(Path to Check=w7, Error In=w14) -> (Existing File Instruction out=w15, Error Out=w16)
            call "Single File Save.gvi"(File Path=w7, Data To Save=w13, Error In=w16, File Operation=w15) -> (Error Out=w17)
            next s1 = w17
          }
          w1 = s1
        }
        frame "TXT Parameters" {
          call "JV Data Adapter.gvi"(JV Measurements Mega Cluster In=$"JV Measurements Mega Cluster In", Error In=w4, Measurement File Type=$"Measurement File Type") -> (Formatted Data String Array=w18, Error Out=w19)
          call "Full Data File Generator.gvi"(Formatted Data String Array=w18, Error In=w19, Measurement File Type=$"Measurement File Type")
          w1 = w4
        }
        frame "Excel" {
          w1 = w4
        }
        frame "Origin" {
          w1 = w4
        }
        frame "Power Point" {
          w1 = w4
        }
      }
    }
  }
  $"Error Out" <- w1
