vi "JV Curves Acquire Subroutine.gvi"   [LabVIEW NXG 5.0.0]
inputs:
  "Instrument Control Mega Cluster In": "Instrument Control Mega Cluster.gtype"
  "JV Measurements Mega Cluster In": "JV Measurements Mega Cluster.gtype" = {"Cell Array"=[], "JV Full Data Array"=[], "JV Curve Parameters"={1, -0.2, FALSE, 0.1, TRUE, 1, 8e-06, 1000, 100, 3, 0.5, 1, 0, 0}, "Cell Selector"={FALSE, FALSE, FALSE, FALSE, FALSE, FALSE, FALSE, FALSE, FALSE, FALSE, FALSE, FALSE, FALSE, FALSE, FALSE, FALSE, FALSE, FALSE, FALSE, FALSE, FALSE, FALSE, FALSE, FALSE, FALSE, FALSE, FALSE, FALSE, FALSE, FALSE}}
  "Error In": error
outputs:
  "Instrument Control Mega Cluster Out": "Instrument Control Mega Cluster.gtype"
  "JV Measurements Mega Cluster Out": "JV Measurements Mega Cluster.gtype"
  "Error Out": error
types:
  T1 = cluster{"Element 1": "VISA Instr", "Element 2": string}
  T2 = enum{"Keithley 2400 Series", "Keithley 2450 Series"}
  "Instrument Control.gtype" = cluster{"Multiplexer Arduino Detected?": bool, "Multiplexer Arduino Address": "VISA Instr", "Arduinos List": T1[], "Multiplexer Log": string, "Keythley Address": "VISA Instr", "Keithley Detected?": bool, "Keithley ID": string, "Detected Keithley Type": T2}
  "Debugging Cluster.gtype" = cluster{"Debugging mode?": bool, "Initialize App": bool, "Insturment Debugging": cluster{"Keithley": bool, "Arduino": bool}}
  "Instrument Control Mega Cluster.gtype" = cluster{"Instrument Control": "Instrument Control.gtype", "Debugging Cluster": "Debugging Cluster.gtype"}
  "Cell Selector.gtype" = enum{"L.01", "L.02", "L.03", "L.04", "L.05", "L.06", "L.07", "L.08", "L.09", "L.10", "L.11", "L.12", "R.01", "R.02", "R.03", "R.04", "R.05", "R.06", "R.07", "R.08", "R.09", "R.10", "R.11", "R.12", "Custom"}
  "JV Data Cluster.gtype" = cluster{"Voltage (V)": f64[], "Current (A)": f64[], "Current Density (A/m^2)": f64[], "Cell Area (m^2)": f64, "Illumination (W/m^2)": f64, "Voc (V)": f64, "Jsc (A/m^2)": f64, "FF (%)": f64, "Rsh (Ω · m^2)": f64, "Rs (Ω · m^2)": f64, "Eff (%)": f64, "Measured Cell": "Cell Selector.gtype", "No Multiplexer": bool}
  "JV Scan Mode.gtype" = enum{"Rough", "Normal", "Accurate", "Smart", "Custom"}
  "JV Curve Parameters.gtype" = cluster{"Cell Parameters": "Cell Parameters.gtype", "Measurement Precision": "Accuracy Parameters.gtype", "JV Scan Mode": "JV Scan Mode.gtype"}
  "JV Measurements Mega Cluster.gtype" = cluster{"Cell Array": "Cell Selector.gtype"[], "JV Full Data Array": "JV Data Cluster.gtype"[], "JV Curve Parameters": "JV Curve Parameters.gtype", "Cell Selector": "Cell Selector.gtype"}
uses:
  Pika IV Characterization NXG::Side Functions::Messages And Prompts::FGV Cancel Prompts until Finished Routine.gvi
  Pika IV Characterization NXG::Side Functions::Instrument Control::Keithley::Keithley Set Constant Parameters.gvi
  Pika IV Characterization NXG::Main Functions::JV Curve Full Subroutine::State Machine::JV Curves Aquiring::Extract Cell Array.gvi
  Pika IV Characterization NXG::Side Functions::Abort Control::FGV Global Abort.gvi
  Pika IV Characterization NXG::Side Functions::Instrument Control::Keithley::Keithley Sweep Subroutine.gvi
  Pika IV Characterization NXG::Main Functions::JV Curve Full Subroutine::State Machine::JV Curves Aquiring::JV Calculations::JV Full Processing.gvi
  Pika IV Characterization NXG::Side Functions::Timeout::Progress General Calculator.gvi
  Pika IV Characterization NXG::Side Functions::Timeout::FGV Progress.gvi
diagram:
  # This SubVI Takes the specified Parameters both for the sweep types and for the keithley electrical sweep and performs all the measurements while storing them on their
  # corresponding clusters, before outputing all the information within the Full IV Curve Data array.
  case ($"Error In") {
    frame Error, Default {
      w1 = $"Error In"
      w2 = $"Instrument Control Mega Cluster In"
      w3 = $"JV Measurements Mega Cluster In"
    }
    frame No Error {
      call "FGV Cancel Prompts until Finished Routine.gvi"(Error In=$"Error In", FGV Instructions="Reset State") -> (Error Out=w4)
      call "Keithley Set Constant Parameters.gvi"(Instrument Control Mega Cluster In=$"Instrument Control Mega Cluster In", JV Measurements Mega Cluster In=$"JV Measurements Mega Cluster In", Error In=w4) -> (Instrument Control Mega Cluster Out=w5, JV Measurements Mega Cluster Out=w6, Error Out=w7)
      call "Extract Cell Array.gvi"(JV Measurements Mega Cluster In=w6, Error In=w7) -> (JV Measurements Mega Cluster Out=w8, Cell Array=w9, Error Out=w10)
      s1 = w10  # shift register
      s2 = w5  # shift register
      s3 = w8  # shift register
      for (iteration -> i1) {
        w11 = each element of w9
        call "FGV Global Abort.gvi"(Global Abort Instructions="Read Current State", Error In=s1) -> (Local Abort Out=w12, Global Abort Out=w13, Error Out=w14)
        call "Keithley Sweep Subroutine.gvi"(Instrument Control Mega Cluster In=s2, JV Measurements Mega Cluster In=s3, Error In=w14) -> (Instrument Control Mega Cluster Out=w15, JV Measurements Mega Cluster Out=w16, JV Data Cluster Out=w17, Error Out=w18)
        call "JV Full Processing.gvi"(JV Measurements Mega Cluster In=w16, JV Data Cluster In=w17, Current Cell=w11, Error In=w18) -> (JV Measurements Mega Cluster Out=w19, Error Out=w20)
        call "Progress General Calculator.gvi"(Starting Value=40, Ending Value=80, Current Step=i1, Error In=w20) -> (Current Progress=w21, Error Out=w22)
        call "FGV Progress.gvi"(FGV Instructions="Set State", Progress In=w21, Error In=w22) -> (Error Out=w23)
        Logical Or(w12, w13) -> w24
        Wait Until Next Multiple(multiple to wait=10)
        next s1 = w23
        next s2 = w15
        next s3 = w19
        stop if w24
      }
      w1 = s1
      w2 = s2
      w3 = s3
    }
  }
  $"Instrument Control Mega Cluster Out" <- w2
  $"JV Measurements Mega Cluster Out" <- w3
  $"Error Out" <- w1
