vi "Layer String Generator.gvi"   [LabVIEW NXG 5.0.0]
inputs:
  "Error In": error
  "Full Layer Information In": "Full Layer Information.gtype"
outputs:
  "Error Out": error
  "Full Layer Information Out": "Full Layer Information.gtype"
types:
  "Blade Coating Parameters.gtype" = cluster{"Thickness (nm)": f64, "Blade Initial Speed (mm/s)": f64, "Speed Gradient": bool, "Blade Final Speed (mm/s)": f64, "Blade Gap (um)": f64, "Blade Temperature (ºC)": f64, "Droplet Volume (ul)": f64, "Subsequent layers": f64, "Glovebox": bool, "Comments": string}
  "Deposition Method.gtype" = enum{"Blade Coating", "Spin Coating", "Thermal Evaporation", "E-beam Evaporation", "Sputtering", "Drop Casting", "Dip Coating", "Pulsed Laser Deposition", "Chemical Vapour Deposition", "Atomic Layer Deposition", "Spray Coating", "Screen Printing", "Electroplating", "Molecular Beam Epitaxy", "Custom Deposition"}
  "Layer Type.gtype" = enum{"Front Electrode", "Electrode Transport Layer", "Active Layer", "Hole Transport Layer", "Back Electrode", "Annealing Treatment", "Encapsulation", "Custom Layer"}
  "Spin Coating Parameters.gtype" = cluster{"Thickness (nm)": f64, "Spin Speed (rpm)": f64, "Dynamic Deposition": bool, "Spin Acceleration (rpm/s)": f64, "Droplet Volume (ul)": f64, "Subsequent layers": f64, "Glovebox": bool, "Comments": string}
  "Thermal Evaporation Parameters.gtype" = cluster{"Thickness (nm)": f64, "Deposition Rate (nm/s)": f64, "Comments": string, "Sample Rotation": bool, "Material": string}
  "Solution Information.gtype" = cluster{"Concentration (mg/ml)": f64, "Stirring Time (kr)": f64, "Glovebox": bool, "Composition Array": cluster{"Material": string, "Ratio": f64}[], "Solvent Array": cluster{"Solvent": string, "Ratio": f64}[], "Solution Preparation Date": f64, "Comments": string}
  "General Parameters.gtype" = cluster{"Thickness (nm)": f64, "Comments": string, "Material": string}
  "Useless Cluster.gtype" = cluster{"Blade Coating Information": bool, "General Information": bool, "Solution Information": bool, "Spin Coating Information": bool, "Thermal Evaporation Information": bool}
  "Full Layer Information.gtype" = cluster{"Blade Coating Parameters": "Blade Coating Parameters.gtype", "Deposition Method": "Deposition Method.gtype", "Layer Type": "Layer Type.gtype", "Spin Coating Parameters": "Spin Coating Parameters.gtype", "Thermal Evaporation Parameters": "Thermal Evaporation Parameters.gtype", "Solution Information": "Solution Information.gtype", "General Parameters": "General Parameters.gtype", "Current Deposition Method Information Cluster": "Useless Cluster.gtype", "Layer String ID": string}
uses:
  NI::G Core::Strings::Trim Whitespace.gvi
diagram:
  case ($"Error In") {
    frame Error, Default {
      w1 = $"Error In"
      w2 = $"Full Layer Information In"
    }
    frame No Error {
      Property Node(instance in=$"Full Layer Information In") -> ("Deposition Method"=w3, instance out=w4)
      case (w3) {
        frame "Blade Coating", Default {
          Property Node(instance in=w4) -> ("Solution Information:Composition Array"=w7, "Blade Coating Parameters:Thickness (nm)"=w8, "Blade Coating Parameters:Blade Initial Speed (mm/s)"=w9, "Blade Coating Parameters:Speed Gradient"=w10, "Blade Coating Parameters:Blade Final Speed (mm/s)"=w11, "Blade Coating Parameters:Comments"=w12, "Blade Coating Parameters:Blade Temperature (ºC)"=w13, instance out=w5)
          Is Empty Array(array=w7) -> w14
          case (w14) {
            frame True {
              w15 = "Unknown Material"
            }
            frame False {
              s1 = ""  # shift register
              for (iteration -> i1) {
                w16 = each element of w7
                Property Node(instance in=w16) -> ("Material"=w17)
                Is Greater Than 0(x=i1) -> w18
                Select(s=w18, t=":", f="") -> w19
                Concatenate Strings(s1, w19, w17) -> w20
                next s1 = w20
              }
              w15 = s1
            }
          }
          Number To Decimal String(number=w8) -> (decimal integer string=w21)
          Concatenate Strings(w21, " nm") -> w22
          Is Not Equal To 0(x=w8) -> w23
          Number To Decimal String(number=w9) -> (decimal integer string=w24)
          Number To Decimal String(number=w11) -> (decimal integer string=w25)
          Concatenate Strings(w24, "-", w25, " mm/s") -> w26
          Concatenate Strings(w24, " mm/s") -> w27
          Select(s=w10, t=w26, f=w27) -> w28
          Number To Decimal String(number=w13) -> (decimal integer string=w29)
          Concatenate Strings(w29, "ºC ", w28) -> w30
          Select(s=w23, t=w22, f=w30) -> w31
          Concatenate Strings(w15, "  ", w31, "  ", w12) -> w6
        }
        frame "Spin Coating" {
          Property Node(instance in=w4) -> ("Solution Information:Composition Array"=w32, "Spin Coating Parameters:Thickness (nm)"=w33, "Spin Coating Parameters:Spin Speed (rpm)"=w34, "Spin Coating Parameters:Dynamic Deposition"=w35, "Spin Coating Parameters:Comments"=w36, instance out=w5)
          Is Empty Array(array=w32) -> w37
          case (w37) {
            frame True {
              w38 = "Unknown Material"
            }
            frame False {
              s2 = ""  # shift register
              for (iteration -> i2) {
                w39 = each element of w32
                Property Node(instance in=w39) -> ("Material"=w40)
                Is Greater Than 0(x=i2) -> w41
                Select(s=w41, t=":", f="") -> w42
                Concatenate Strings(s2, w42, w40) -> w43
                next s2 = w43
              }
              w38 = s2
            }
          }
          Number To Decimal String(number=w33) -> (decimal integer string=w44)
          Concatenate Strings(w44, " nm") -> w45
          Number To Decimal String(number=w34) -> (decimal integer string=w46)
          Concatenate Strings(w46, "rpm Dyn ") -> w47
          Concatenate Strings(w46, "rpm") -> w48
          Select(s=w35, t=w47, f=w48) -> w49
          Is Not Equal To 0(x=w33) -> w50
          Select(s=w50, t=w45, f=w49) -> w51
          Concatenate Strings(w38, "  ", w51, "  ", w36) -> w6
        }
        frame "Dip Coating" {
          Property Node(instance in=w4) -> ("Solution Information:Composition Array"=w52, "General Parameters:Thickness (nm)"=w53, "General Parameters:Comments"=w54, instance out=w5)
          Is Empty Array(array=w52) -> w55
          case (w55) {
            frame True {
              w56 = "Unknown Material"
            }
            frame False {
              s3 = ""  # shift register
              for (iteration -> i3) {
                w57 = each element of w52
                Property Node(instance in=w57) -> ("Material"=w58)
                Is Greater Than 0(x=i3) -> w59
                Select(s=w59, t=":", f="") -> w60
                Concatenate Strings(s3, w60, w58) -> w61
                next s3 = w61
              }
              w56 = s3
            }
          }
          Is Not Equal To 0(x=w53) -> w62
          Number To Decimal String(number=w53) -> (decimal integer string=w63)
          Concatenate Strings(w63, " nm") -> w64
          Select(s=w62, t="", f=w64) -> w65
          Concatenate Strings(w56, "  ", w65, "  ", w54) -> w6
        }
        frame "Custom Deposition" {
          Property Node(instance in=w4) -> ("Solution Information:Composition Array"=w66, "General Parameters:Thickness (nm)"=w67, "General Parameters:Comments"=w68, instance out=w5)
          Is Empty Array(array=w66) -> w69
          case (w69) {
            frame True {
              w70 = "Unknown Material"
            }
            frame False {
              s4 = ""  # shift register
              for (iteration -> i4) {
                w71 = each element of w66
                Property Node(instance in=w71) -> ("Material"=w72)
                Is Greater Than 0(x=i4) -> w73
                Select(s=w73, t=":", f="") -> w74
                Concatenate Strings(s4, w74, w72) -> w75
                next s4 = w75
              }
              w70 = s4
            }
          }
          Is Equal To 0(x=w67) -> w76
          Number To Decimal String(number=w67) -> (decimal integer string=w77)
          Concatenate Strings(w77, " nm") -> w78
          Select(s=w76, t="", f=w78) -> w79
          Concatenate Strings(w70, "  ", w79, "  ", w68) -> w6
        }
        frame "Drop Casting" {
          Property Node(instance in=w4) -> ("Solution Information:Composition Array"=w80, "General Parameters:Thickness (nm)"=w81, "General Parameters:Comments"=w82, instance out=w5)
          Is Empty Array(array=w80) -> w83
          case (w83) {
            frame True {
              w84 = "Unknown Material"
            }
            frame False {
              s5 = ""  # shift register
              for (iteration -> i5) {
                w85 = each element of w80
                Property Node(instance in=w85) -> ("Material"=w86)
                Is Greater Than 0(x=i5) -> w87
                Select(s=w87, t=":", f="") -> w88
                Concatenate Strings(s5, w88, w86) -> w89
                next s5 = w89
              }
              w84 = s5
            }
          }
          Is Equal To 0(x=w81) -> w90
          Number To Decimal String(number=w81) -> (decimal integer string=w91)
          Concatenate Strings(w91, " nm") -> w92
          Select(s=w90, t="", f=w92) -> w93
          Concatenate Strings(w84, "  ", w93, "  ", w82) -> w6
        }
        frame "Spray Coating" {
          Property Node(instance in=w4) -> ("Solution Information:Composition Array"=w94, "General Parameters:Thickness (nm)"=w95, "General Parameters:Comments"=w96, instance out=w5)
          Is Empty Array(array=w94) -> w97
          case (w97) {
            frame True {
              w98 = "Unknown Material"
            }
            frame False {
              s6 = ""  # shift register
              for (iteration -> i6) {
                w99 = each element of w94
                Property Node(instance in=w99) -> ("Material"=w100)
                Is Greater Than 0(x=i6) -> w101
                Select(s=w101, t=":", f="") -> w102
                Concatenate Strings(s6, w102, w100) -> w103
                next s6 = w103
              }
              w98 = s6
            }
          }
          Is Equal To 0(x=w95) -> w104
          Number To Decimal String(number=w95) -> (decimal integer string=w105)
          Concatenate Strings(w105, " nm") -> w106
          Select(s=w104, t="", f=w106) -> w107
          Concatenate Strings(w98, "  ", w107, "  ", w96) -> w6
        }
        frame "Screen Printing" {
          Property Node(instance in=w4) -> ("Solution Information:Composition Array"=w108, "General Parameters:Thickness (nm)"=w109, "General Parameters:Comments"=w110, instance out=w5)
          Is Empty Array(array=w108) -> w111
          case (w111) {
            frame True {
              w112 = "Unknown Material"
            }
            frame False {
              s7 = ""  # shift register
              for (iteration -> i7) {
                w113 = each element of w108
                Property Node(instance in=w113) -> ("Material"=w114)
                Is Greater Than 0(x=i7) -> w115
                Select(s=w115, t=":", f="") -> w116
                Concatenate Strings(s7, w116, w114) -> w117
                next s7 = w117
              }
              w112 = s7
            }
          }
          Is Equal To 0(x=w109) -> w118
          Number To Decimal String(number=w109) -> (decimal integer string=w119)
          Concatenate Strings(w119, " nm") -> w120
          Select(s=w118, t="", f=w120) -> w121
          Concatenate Strings(w112, "  ", w121, "  ", w110) -> w6
        }
        frame "Thermal Evaporation" {
          Property Node(instance in=w4) -> ("Thermal Evaporation Parameters:Material"=w122, "Thermal Evaporation Parameters:Thickness (nm)"=w123, "Thermal Evaporation Parameters:Deposition Rate (nm/s)"=w124, "Thermal Evaporation Parameters:Comments"=w125, instance out=w5)
          Number To Decimal String(number=w123) -> (decimal integer string=w126)
          Number To Decimal String(number=w124) -> (decimal integer string=w127)
          Concatenate Strings(w126, " nm", w127, " nm/s") -> w128
          Is Equal To 0(x=w123) -> w129
          Select(s=w129, t="", f=w128) -> w130
          Concatenate Strings(w122, "  ", w130, "  ", w125) -> w6
        }
        frame "Pulsed Laser Deposition" {
          Property Node(instance in=w4) -> ("General Parameters:Material"=w131, "General Parameters:Thickness (nm)"=w132, "Thermal Evaporation Parameters:Comments"=w133, instance out=w5)
          Is Equal To 0(x=w132) -> w134
          Number To Decimal String(number=w132) -> (decimal integer string=w135)
          Concatenate Strings(w135, " nm") -> w136
          Select(s=w134, t="", f=w136) -> w137
          Concatenate Strings(w131, "  ", w137, "  ", w133) -> w6
        }
        frame "Electroplating" {
          Property Node(instance in=w4) -> ("General Parameters:Material"=w138, "General Parameters:Thickness (nm)"=w139, "Thermal Evaporation Parameters:Comments"=w140, instance out=w5)
          Is Equal To 0(x=w139) -> w141
          Number To Decimal String(number=w139) -> (decimal integer string=w142)
          Concatenate Strings(w142, " nm") -> w143
          Select(s=w141, t="", f=w143) -> w144
          Concatenate Strings(w138, "  ", w144, "  ", w140) -> w6
        }
        frame "Molecular Beam Epitaxy" {
          Property Node(instance in=w4) -> ("General Parameters:Material"=w145, "General Parameters:Thickness (nm)"=w146, "Thermal Evaporation Parameters:Comments"=w147, instance out=w5)
          Is Equal To 0(x=w146) -> w148
          Number To Decimal String(number=w146) -> (decimal integer string=w149)
          Concatenate Strings(w149, " nm") -> w150
          Select(s=w148, t="", f=w150) -> w151
          Concatenate Strings(w145, "  ", w151, "  ", w147) -> w6
        }
        frame "E-beam Evaporation" {
          Property Node(instance in=w4) -> ("General Parameters:Material"=w152, "General Parameters:Thickness (nm)"=w153, "Thermal Evaporation Parameters:Comments"=w154, instance out=w5)
          Is Equal To 0(x=w153) -> w155
          Number To Decimal String(number=w153) -> (decimal integer string=w156)
          Concatenate Strings(w156, " nm") -> w157
          Select(s=w155, t="", f=w157) -> w158
          Concatenate Strings(w152, "  ", w158, "  ", w154) -> w6
        }
        frame "Chemical Vapour Deposition" {
          Property Node(instance in=w4) -> ("General Parameters:Material"=w159, "General Parameters:Thickness (nm)"=w160, "Thermal Evaporation Parameters:Comments"=w161, instance out=w5)
          Is Equal To 0(x=w160) -> w162
          Number To Decimal String(number=w160) -> (decimal integer string=w163)
          Concatenate Strings(w163, " nm") -> w164
          Select(s=w162, t="", f=w164) -> w165
          Concatenate Strings(w159, "  ", w165, "  ", w161) -> w6
        }
        frame "Sputtering" {
          Property Node(instance in=w4) -> ("General Parameters:Material"=w166, "General Parameters:Thickness (nm)"=w167, "Thermal Evaporation Parameters:Comments"=w168, instance out=w5)
          Is Equal To 0(x=w167) -> w169
          Number To Decimal String(number=w167) -> (decimal integer string=w170)
          Concatenate Strings(w170, " nm") -> w171
          Select(s=w169, t="", f=w171) -> w172
          Concatenate Strings(w166, "  ", w172, "  ", w168) -> w6
        }
        frame "Atomic Layer Deposition" {
          Property Node(instance in=w4) -> ("General Parameters:Material"=w173, "General Parameters:Thickness (nm)"=w174, "Thermal Evaporation Parameters:Comments"=w175, instance out=w5)
          Is Equal To 0(x=w174) -> w176
          Number To Decimal String(number=w174) -> (decimal integer string=w177)
          Concatenate Strings(w177, " nm") -> w178
          Select(s=w176, t="", f=w178) -> w179
          Concatenate Strings(w173, "  ", w179, "  ", w175) -> w6
        }
      }
      call "Trim Whitespace.gvi"(string=w6) -> (trimmed string=w180)
      Property Node(instance in=w5, "Layer String ID"=w180) -> (instance out=w2)
      w1 = $"Error In"
    }
  }
  $"Error Out" <- w1
  $"Full Layer Information Out" <- w2
