vi "Default Configuration Handler.gvi"   [LabVIEW NXG 5.0.0]
inputs:
  "Error In": error
outputs:
  "Error Out": error
panel controls:
  "Misc Data Mega Cluster In": "Misc Mega Cluster.gtype"
  "Configuration File Operation": "Configuration File Operation.gtype" = "Save Configuration File"
panel indicators:
  "Misc Data Mega Cluster Out": "Misc Mega Cluster.gtype"
types:
  T1 = cluster{"State Ref": "StringControl reference", "Substate Ref": "StringControl reference", "Current State Ref": "EnumSelector reference", "Main Tab Ref": "TabControl reference", "Plot Now Flag Ref": "BooleanControl reference"}
  T2 = cluster{"Default Data Saving Location Ref": "PathSelector reference"}
  T3 = cluster{"Author Initials Ref": "ComboBoxSelector reference", "Batch Name Ref": "StringControl reference", "Cell Number Ref": "StringControl reference", "Current Date Ref": "StringControl reference", "Sample Comments Ref": "StringControl reference", "Sample Prefix Ref": "StringControl reference", "Custom Date Ref": "CheckBox reference", "Label Info Error Label Ref": "StringControl reference", "Label Info Missing Error Ref": "BooleanControl reference"}
  T4 = cluster{"Cell Parameters Ref": "Cluster reference", "Cell Selector Ref": "Cluster reference", "Measurement Precision Ref": "Cluster reference", "JV Scan Mode Ref": "EnumSelector reference"}
  T5 = cluster{"Progress % Ref": "ProgressBar reference", "Progress Counter Ref": "NumericTextBoxDouble reference", "Live JV Parameters Ref": "Cluster reference"}
  T6 = cluster{"Layer Information Ref": "ArrayViewer reference"[]}
  T7 = cluster{"Cell Selector Block Ref": "Rectangle reference", "Smart Mode Block Ref": "Rectangle reference", "dV Block Ref": "Rectangle reference", "Smart Mode Text Ref": "Text reference", "No Multiplexer Detected Text Ref": "Text reference"}
  T8 = cluster{"JV Measurements Mega Cluster Ref": "Cluster reference", "Instrument Control Mega Cluster Ref": "Cluster reference"}
  T9 = cluster{"JV Main Graph Ref": "Graph reference", "Voc Graph Ref ": "Graph reference", "Jsc Graph Ref": "Graph reference", "Efficiency Graph Ref": "Graph reference", "Fill Factor Graph Ref": "Graph reference", "Series Resistance Graph Ref": "Graph reference", "Shunt Resistance Graph Ref": "Graph reference"}
  "Full Reference Cluster.gtype" = cluster{"Status Report": T1, "Path Cluster": T2, "Sample Naming Cluster": T3, "Acquisition Parameters": T4, "Live Progress Cluster": T5, "Sample Extra Information": T6, "Visual Elements": T7, "Mega Cluster References": T8, "Plotting": T9, "System Parameters": cluster{"Main VI Ref": VIRefnum}}
  "Misc Mega Cluster.gtype" = cluster{"Full Reference Cluster": "Full Reference Cluster.gtype"}
  "Configuration File Operation.gtype" = enum{"Save Configuration File", "Load Configuration File", "Erase Configuration File"}
uses:
  Pika IV Characterization NXG::Main Functions::Layer Composition::File Management::Check Author Empty.gvi
  Pika IV Characterization NXG::Main Functions::Layer Composition::File Management::Generate Author Path.gvi
  Pika IV Characterization NXG::Side Functions::Path Manipulation::Name File Prompt Window.gvi
  Pika IV Characterization NXG::Side Functions::Path Manipulation::Path Already Exists prompt.gvi
  Pika IV Characterization NXG::Side Functions::Path Manipulation::Rename Prompt Window.gvi
diagram:
  case ($"Error In") {
    frame Error, Default {
      w1 = $"Error In"
      w2 = $"Misc Data Mega Cluster In"
    }
    frame No Error {
      call "Check Author Empty.gvi"(Misc Data Mega Cluster In=$"Misc Data Mega Cluster In", Error In=$"Error In") -> (Misc Data Mega Cluster Out=w3, Author Initials=w4, No Author?=w5, Error Out=w6)
      case (w5) {
        frame True { }
        frame False {
          call "Generate Author Path.gvi"(Authors Initials=w4, Error In=w6) -> (Author Path=w7, Error Out=w8)
          case ($"Configuration File Operation") {
            frame "Save Configuration File", Default {
              call "Name File Prompt Window.gvi"(Error In=w8) -> (Output=w9, Error Out=w10)
              Build Path(base path=w7, name or relative path=w9) -> (appended path=w11)
              call "Path Already Exists prompt.gvi"(Path to Check=w11, Error In=w10) -> (Existing File Instruction out=w12, Error Out=w13)
              case (w12) {
                frame "Replace" { }
                frame "Rename", Default {
                  Strip Path(path=w11) -> (name=w14, stripped path=w15)
                  call "Rename Prompt Window.gvi"(Original Filename=w14, Error In=w13) -> (Output=w16, Error Out=w17)
                  Build Path(base path=w15, name or relative path=w16) -> (appended path=w18)
                  Open Or Create Or Replace File(error in=w17, file path (use dialog)=w18, operation (0:open)="replace or create") -> (error out=w19, refnum out=w20)
                  Write To Text File(error in=w19, file (use dialog)=w20) -> (error out=w21, refnum out=w22)
                  Close File(error in=w21, refnum=w22) -> (error out=w23)
                }
                frame "Do not save" { }
              }
            }
            frame "Load Configuration File" { }
          }
        }
      }
      w1 = _
      w2 = _
    }
  }
  $"Error Out" <- w1
  $"Misc Data Mega Cluster Out" <- w2
