vi "Generate Author Path.gvi"   [LabVIEW NXG 5.0.0]
inputs:
  "Error In": error
  "Authors Initials": string
outputs:
  "Error Out": error
  "Author Path": path
diagram:
  case ($"Error In") {
    frame Error, Default {
      w1 = $"Error In"
      w2 = default
    }
    frame No Error {
      Get Component Directory() -> (Path=w3)
      Build Path(base path=w3, name or relative path="Layer_Default_Files") -> (appended path=w4)
      Build Path(base path=w4, name or relative path=$"Authors Initials") -> (appended path=w2)
      w1 = $"Error In"
    }
  }
  $"Error Out" <- w1
  $"Author Path" <- w2
