vi "Main Window.gvi"   [LabVIEW NXG 5.0.0]
panel controls:
  "Acquire Button": bool
  "Load Measurement": bool
  "Save Measurement": bool
  "Main Tab": i32
  "Custom date": bool
  "Author Initials": string
  "Batch Name": string
  "Cell Label": string
  "Sample Comments": string
  "Abort Button": bool
  "Add Layer Button": bool
  "Delete Last Layer": bool
  "Edit Layers": bool
  "Label Info Error Label": string
  "Label Info Missing Error": bool
  "Config Tab": i32
  "Misc Data Mega Cluster": "Misc Mega Cluster.gtype"
  "Instrument Control Mega Cluster": "Instrument Control Mega Cluster.gtype"
  "Desired Cell": "Cell Selector.gtype" = "L.01"
  "Set Cell": bool
  "Cell Parameters": "Cell Parameters.gtype" = {"Max (V)"=1, "Min (V)"=-0.2, "Sweep Dir"=FALSE, "Curr Range (A)"=0.1, "Autorange"=TRUE, "Max (A)"=1, "Cell Area (m^2)"=8e-06, "Light Power (W m^-2)"=1000}
  "JV Scan Mode": "JV Scan Mode.gtype" = "Rough"
  "Measurement Precision": "Accuracy Parameters.gtype"
  "Default Data Saving Location": path = path "C:\\Users\\minus\\Documents\\LabVIEW Projects\\Pika_IV_Characterization_NXG\\Tests"
  "Cell Selector": "Cell Selector.gtype"
  "JV Measurements Mega Cluster": "JV Measurements Mega Cluster.gtype"
  "Plot Now Flag": bool
  "Load Default Layers": bool
panel indicators:
  "Current Date": string
  "Progress %": f64
  "State": string
  "Substate": string
  "Sample Prefix": string
  "Progress counter": f64
  "Layer Information": string[]
  "Live JV Parameters": "Live JV Parameters.gtype"
  "JV Main Graph": cluster{"Element 1": f64[], "Element 2": f64[]}[]
  "Current State": "Queue Instructions Control.gtype"
  "Elapsed Time (kr)": f64
  "Estimated Time (kr)": f64
  "Voc Graph": cluster{"Element 1": f64[], "Element 2": f64[]}[]
  "Jsc Graph": cluster{"Element 1": f64[], "Element 2": f64[]}[]
  "Efficiency Graph": cluster{"Element 1": f64[], "Element 2": f64[]}[]
  "Fill Factor Graph": cluster{"Element 1": f64[], "Element 2": f64[]}[]
  "Series Resistance Graph": cluster{"Element 1": f64[], "Element 2": f64[]}[]
  "Shunt Resistance Graph": cluster{"Element 1": f64[], "Element 2": f64[]}[]
types:
  "Live JV Parameters.gtype" = cluster{"Current (A)": f64, "Voltage (V)": f64, "Cur Density (A/m^2)": f64, "Current Cell": enum{""}}
  T1 = cluster{"State Ref": "StringControl reference", "Substate Ref": "StringControl reference", "Current State Ref": "EnumSelector reference", "Main Tab Ref": "TabControl reference", "Plot Now Flag Ref": "BooleanControl reference"}
  T2 = cluster{"Default Data Saving Location Ref": "PathSelector reference"}
  T3 = cluster{"Author Initials Ref": "ComboBoxSelector reference", "Batch Name Ref": "StringControl reference", "Cell Number Ref": "StringControl reference", "Current Date Ref": "StringControl reference", "Sample Comments Ref": "StringControl reference", "Sample Prefix Ref": "StringControl reference", "Custom Date Ref": "CheckBox reference", "Label Info Error Label Ref": "StringControl reference", "Label Info Missing Error Ref": "BooleanControl reference"}
  T4 = cluster{"Cell Parameters Ref": "Cluster reference", "Cell Selector Ref": "Cluster reference", "Measurement Precision Ref": "Cluster reference", "JV Scan Mode Ref": "EnumSelector reference"}
  T5 = cluster{"Progress % Ref": "ProgressBar reference", "Progress Counter Ref": "NumericTextBoxDouble reference", "Live JV Parameters Ref": "Cluster reference"}
  T6 = cluster{"Layer Information Ref": "ArrayViewer reference"[]}
  T7 = cluster{"Cell Selector Block Ref": "Rectangle reference", "Smart Mode Block Ref": "Rectangle reference", "dV Block Ref": "Rectangle reference", "Smart Mode Text Ref": "Text reference", "No Multiplexer Detected Text Ref": "Text reference"}
  T8 = cluster{"JV Measurements Mega Cluster Ref": "Cluster reference", "Instrument Control Mega Cluster Ref": "Cluster reference"}
  T9 = cluster{"JV Main Graph Ref": "Graph reference", "Voc Graph Ref ": "Graph reference", "Jsc Graph Ref": "Graph reference", "Efficiency Graph Ref": "Graph reference", "Fill Factor Graph Ref": "Graph reference", "Series Resistance Graph Ref": "Graph reference", "Shunt Resistance Graph Ref": "Graph reference"}
  "Full Reference Cluster.gtype" = cluster{"Status Report": T1, "Path Cluster": T2, "Sample Naming Cluster": T3, "Acquisition Parameters": T4, "Live Progress Cluster": T5, "Sample Extra Information": T6, "Visual Elements": T7, "Mega Cluster References": T8, "Plotting": T9, "System Parameters": cluster{"Main VI Ref": VIRefnum}}
  "Deposition Method.gtype" = enum{"Blade Coating", "Spin Coating", "Thermal Evaporation", "E-beam Evaporation", "Sputtering", "Drop Casting", "Dip Coating", "Pulsed Laser Deposition", "Chemical Vapour Deposition", "Atomic Layer Deposition", "Spray Coating", "Screen Printing", "Electroplating", "Molecular Beam Epitaxy", "Custom Deposition"}
  "Layer Type.gtype" = enum{"Front Electrode", "Electrode Transport Layer", "Active Layer", "Hole Transport Layer", "Back Electrode", "Annealing Treatment", "Encapsulation", "Custom Layer"}
  "Full Layer Information.gtype" = cluster{"Blade Coating Parameters": "Blade Coating Parameters.gtype", "Deposition Method": "Deposition Method.gtype", "Layer Type": "Layer Type.gtype", "Spin Coating Parameters": "Spin Coating Parameters.gtype", "Thermal Evaporation Parameters": "Thermal Evaporation Parameters.gtype", "Solution Information": "Solution Information.gtype", "General Parameters": "General Parameters.gtype", "Current Deposition Method Information Cluster": "Useless Cluster.gtype", "Layer String ID": string}
  "Misc Mega Cluster.gtype" = cluster{"Full Reference Cluster": "Full Reference Cluster.gtype", "Full Layer Information Array": "Full Layer Information.gtype"[]}
  "Queue Instructions Control.gtype" = enum{"Undefined State", "Debug Check", "Initialize App", "Idle", "Change Cell", "IV Curves Acquisition", "Saving TXT Files", "Generating Origin Files", "Stopping App", "Add Layer", "State2", "State3", "State4", "State5"}
  T10 = cluster{"Element 1": "VISA Instr", "Element 2": string}
  T11 = enum{"Keithley 2400 Series", "Keithley 2450 Series"}
  "Instrument Control.gtype" = cluster{"Multiplexer Arduino Detected?": bool, "Multiplexer Arduino Address": "VISA Instr", "Arduinos List": T10[], "Multiplexer Log": string, "Keythley Address": "VISA Instr", "Keithley Detected?": bool, "Keithley ID": string, "Detected Keithley Type": T11}
  "Debugging Cluster.gtype" = cluster{"Debugging mode?": bool, "Initialize App": bool, "Insturment Debugging": cluster{"Keithley": bool, "Arduino": bool}}
  "Instrument Control Mega Cluster.gtype" = cluster{"Instrument Control": "Instrument Control.gtype", "Debugging Cluster": "Debugging Cluster.gtype"}
  "Cell Selector.gtype" = enum{"L.01", "L.02", "L.03", "L.04", "L.05", "L.06", "L.07", "L.08", "L.09", "L.10", "L.11", "L.12", "R.01", "R.02", "R.03", "R.04", "R.05", "R.06", "R.07", "R.08", "R.09", "R.10", "R.11", "R.12", "Custom"}
  "Cell Parameters.gtype" = cluster{"Max (V)": f64, "Min (V)": f64, "Sweep Dir": bool, "Curr Range (A)": f64, "Autorange": bool, "Max (A)": f64, "Cell Area (m^2)": f64, "Light Power (W m^-2)": f64}
  "JV Scan Mode.gtype" = enum{"Rough", "Normal", "Accurate", "Smart", "Custom"}
  "Accuracy Parameters.gtype" = cluster{"V Points": u32, "Current Avg": u32, "Integration Time": f64, "Iterations": u32, "Rs Rsh Slope points": u32, "dV (V)": f64}
  "JV Data Cluster.gtype" = cluster{"Voltage (V)": f64[], "Current (A)": f64[], "Current Density (A/m^2)": f64[], "Cell Area (m^2)": f64, "Illumination (W/m^2)": f64, "Voc (V)": f64, "Jsc (A/m^2)": f64, "FF (%)": f64, "Rsh (Ω · m^2)": f64, "Rs (Ω · m^2)": f64, "Eff (%)": f64, "Measured Cell": "Cell Selector.gtype", "No Multiplexer": bool}
  "JV Curve Parameters.gtype" = cluster{"JV Scan Mode": "JV Scan Mode.gtype", "Measurement Precision": "Accuracy Parameters.gtype", "Cell Parameters": "Cell Parameters.gtype"}
  "JV Measurements Mega Cluster.gtype" = cluster{"Cell Array": "Cell Selector.gtype"[], "JV Full Data Array": "JV Data Cluster.gtype"[], "Cell Selector": "Cell Selector.gtype", "JV Curve Parameters": "JV Curve Parameters.gtype"}
uses:
  Pika IV Characterization NXG::Main Functions::Initializing App::Reference Setting::Acquisition Parameters.gvi
  Pika IV Characterization NXG::Main Functions::Initializing App::Reference Setting::Live Progress Cluster.gvi
  Pika IV Characterization NXG::Main Functions::Initializing App::Reference Setting::Path Cluster.gvi
  Pika IV Characterization NXG::Main Functions::Initializing App::Reference Setting::System.gvi
  Pika IV Characterization NXG::Main Functions::Initializing App::Reference Setting::Mega Clusters.gvi
  Pika IV Characterization NXG::Main Functions::Initializing App::Reference Setting::Visual Elements.gvi
  Pika IV Characterization NXG::Main Functions::Initializing App::Reference Setting::Sample Extra Information.gvi
  Pika IV Characterization NXG::Main Functions::Initializing App::Reference Setting::Plotting.gvi
  Pika IV Characterization NXG::Main Functions::Initializing App::Reference Setting::Sample Naming Cluster.gvi
  Pika IV Characterization NXG::Main Functions::Initializing App::Reference Setting::Status Report.gvi
  Pika IV Characterization NXG::Side Functions::Abort Control::FGV Global Abort.gvi
  Pika IV Characterization NXG::Main Functions::Instruction Handling::FGV Current State.gvi
  Pika IV Characterization NXG::Main Functions::Timeout::FGV Progress.gvi
  Pika IV Characterization NXG::Main Functions::Timeout::Time Out Subroutine.gvi
  Pika IV Characterization NXG::Side Functions::Exit App Sequence.gvi
  Pika IV Characterization NXG::Side Functions::Utilities::Cell Naming::Sample Naming Subroutine.gvi
  Pika IV Characterization NXG::Side Functions::Utilities::Cell Naming::FGV Sample Prefix.gvi
  Pika IV Characterization NXG::Main Functions::Instruction Handling::Check Queue And Label.gvi
  Pika IV Characterization NXG::Main Functions::JV Curve Full Subroutine::Any Cell Selected Check.gvi
  Pika IV Characterization NXG::Main Functions::Instruction Handling::Condition Enqueue.gvi
  Pika IV Characterization NXG::Main Functions::JV Curve Full Subroutine::JV Operation Translation.gvi
  Pika IV Characterization NXG::Side Functions::Instrument Control::Arduino Multiplexer::Set Cell Requisites.gvi
  Pika IV Characterization NXG::Main Functions::Update Clusters::Update Cluster Info Subroutine.gvi
  NI::G Core::Error::Is Error.gvi
  Pika IV Characterization NXG::Side Functions::Abort Control::Abort Sequence.gvi
  Pika IV Characterization NXG::Side Functions::Debugging::Debugging Prompt.gvi
  Pika IV Characterization NXG::Main Functions::Initializing App::Initialize App Subroutine.gvi
  Pika IV Characterization NXG::Side Functions::Instrument Control::Arduino Multiplexer::Set Cell Subroutine.gvi
  Pika IV Characterization NXG::Main Functions::JV Curve Full Subroutine::Full JV Curve Measurement Subroutine.gvi
  Pika IV Characterization NXG::Main Functions::Layer Composition::New Layer Prompt.gvi
  Pika IV Characterization NXG::Main Functions::Layer Composition::Data Management::Layer String Array Generator.gvi
  NI::G Core::Error::Multiplex Errors.gvi
  NI::G Core::Error::Display Error.gvi
diagram:
  case (TRUE) {
    frame False, Default {
      w1 = default
    }
    frame True {
      Property Node(instance in=$"Misc Data Mega Cluster") -> ("Full Reference Cluster"=w2, instance out=w3)
      call "Acquisition Parameters.gvi"(Cell Parameters Ref=reference to "Cell Parameters", JV Scan Mode Ref=reference to "JV Scan Mode", Measurement Precision Ref=reference to "Measurement Precision", Cell Selector Ref=reference to "Cell Selector", Full Reference Cluster In=w2) -> (Error Out=w4, Full Reference Cluster Out=w5)
      call "Live Progress Cluster.gvi"(Progress % Ref=reference to "Progress %", Progress Counter Ref=reference to "Progress counter", Live JV Parameters Ref=reference to "Live JV Parameters", Error In=w4, Full Reference Cluster In=w5) -> (Error Out=w6, Full Reference Cluster Out=w7)
      call "Path Cluster.gvi"(Default Data Saving Location Ref=reference to "Default Data Saving Location", Error In=w6, Full Reference Cluster=w7) -> (Error Out=w8, Full Reference Cluster Out=w9)
      This VI Reference() -> (reference out=w10)
      call "System.gvi"(Main VI Ref=w10, Error In=w8, Full Reference Cluster=w9) -> (Error Out=w11, Full Reference Cluster Out=w12)
      call "Mega Clusters.gvi"(JV Measurements Mega Cluster Ref=reference to "JV Measurements Mega Cluster", Instrument Control Mega Cluster Ref=reference to "Instrument Control Mega Cluster", Error In=w11, Full Reference Cluster=w12) -> (Error Out=w13, Full Reference Cluster Out=w14)
      call "Visual Elements.gvi"(Cell Selector Block Ref=reference to unnamed rectangle, No Multiplexer Detected Text Ref=reference to unnamed text, dV Block Ref=reference to unnamed rectangle, Smart Mode Text Ref=reference to unnamed text, Error In=w13, Full Reference Cluster=w14) -> (Error Out=w15, Full Reference Cluster Out=w16)
      call "Sample Extra Information.gvi"(Layer Information Ref=reference to "Layer Information", Error In=w15, Full Reference Cluster=w16) -> (Error Out=w17, Full Reference Cluster Out=w18)
      call "Plotting.gvi"(JV Main Graph Ref=reference to "JV Main Graph", Voc Graph Ref=reference to "Voc Graph", Jsc Graph Ref=reference to "Jsc Graph", Efficiency Graph Ref=reference to "Efficiency Graph", Fill Factor Graph Ref=reference to "Fill Factor Graph", Series Resistance Graph Ref=reference to "Series Resistance Graph", Shunt Resistance Graph Ref=reference to "Shunt Resistance Graph", Error In=w17, Full Reference Cluster In=w18) -> (Error Out=w19, Full Reference Cluster Out=w20)
      call "Sample Naming Cluster.gvi"(Author Initials Ref=reference to "Author Initials", Batch Name Ref=reference to "Batch Name", Cell Number Ref=reference to "Cell Label", Current Date Ref=reference to "Current Date", Sample Comments Ref=reference to "Sample Comments", Sample Prefix Ref=reference to "Sample Prefix", Custom Date Ref=reference to "Custom date", Label Info Error Label Ref=reference to "Label Info Error Label", Label Info Missing Error Ref=reference to "Label Info Missing Error", Error In=w19, Full Reference Cluster In=w20) -> (Error Out=w21, Full Reference Cluster Out=w22)
      call "Status Report.gvi"(State Ref=reference to "State", Substate Ref=reference to "Substate", Current State Ref=reference to "Current State", Main Tab Ref=reference to "Main Tab", Plot Now Flag Ref=reference to "Plot Now Flag", Error In=w21, Full Reference Cluster In=w22) -> (Error Out=w1, Full Reference Cluster Out=w23)
      Property Node(instance in=w3, "Full Reference Cluster"=w23) -> (instance out=w24)
      $"Misc Data Mega Cluster" <- w24
    }
  }
  call "FGV Global Abort.gvi"(Global Abort Instructions="Reset State", Error In=w1) -> (Error Out=w25)
  call "FGV Current State.gvi"(Current State Instructions="Set Current State and Substate", Current State="Undefined State", Current Substate="Starting Up", Error In=w25) -> (Error Out=w26)
  Obtain Queue(create if not found=TRUE, element data type="Queue Instructions Control.gtype" "Undefined State", error in=w26, name="Instruction Queue") -> (error out=w27, queue out=w28)
  Enqueue Element(element="Debug Check", error in=w27, queue=w28) -> (error out=w29, queue out=w30)
  s1 = w30  # shift register
  while {
    event (timeout = 50) {
      on "Timeout" {
        call "FGV Progress.gvi"(FGV Instructions="Read State", Error In=w29) -> (Progress Out=w34, Elapsed Time Out (kr)=w35, Estimated Time Out (kr)=w36, Error Out=w37)
        $"Progress %" <- w34
        $"Progress counter" <- w34
        call "Time Out Subroutine.gvi"(Queue In=s1, Misc Data Mega Cluster In=$"Misc Data Mega Cluster", Error In=w37) -> (Queue Out=w32, Stop App?=w33, Error Out=w31)
        $"Estimated Time (kr)" <- w36
        $"Elapsed Time (kr)" <- w35
      }
      on "Window" Close? {
        call "Exit App Sequence.gvi"(Queue In=s1, Error In=w29) -> (Queue Out=w32, Exit?=w38, Error Out=w31)
        Not(x=w38) -> w39
        Event Filter("Discard?"=w39)
        w33 = default
      }
      on "Author Initials" Value changed; "Batch Name" Value changed; "Cell Label" Value changed; "Current Date" Value changed; "Custom date" Value changed; "Sample Comments" Value changed; "Sample Prefix" Value changed {
        call "Sample Naming Subroutine.gvi"(Misc Data Mega Cluster In=$"Misc Data Mega Cluster", Error In=w29) -> (Misc Data Mega Cluster Out=w40, Error Out=w41)
        $"Misc Data Mega Cluster" <- w40
        call "FGV Sample Prefix.gvi"(FGV Instructions="Set State", Misc Mega Cluster In=w40, Error In=w41) -> (Error Out=w31)
        w32 = s1
        w33 = default
      }
      on "Acquire Button" Value changed; "Save Measurement" Value changed {
        call "Check Queue And Label.gvi"(Label Info Error Label=$"Label Info Error Label", Label Info Missing Error=$"Label Info Missing Error", Error In=w29, Is Label Necessary?=TRUE) -> (Proceed to enqueue=w42, Error Out=w43)
        call "Any Cell Selected Check.gvi"(Proceed to enqueue In=w42, Error In=w43, JV Measurements Mega Cluster In=$"JV Measurements Mega Cluster") -> (Proceed to enqueue Out=w44, Error Out=w45)
        call "Condition Enqueue.gvi"(Queue In=s1, Queue Instruction="IV Curves Acquisition", Error In=w45, Equeue?=w44) -> (Queue Out=w32, Error Out=w46)
        call "JV Operation Translation.gvi"(Acquire Button=$"Acquire Button", Load Measurement=FALSE, Save Measurement=$"Save Measurement", Error In=w46) -> (Error Out=w31)
        w33 = default
      }
      on "Load Measurement" Value changed {
        call "Check Queue And Label.gvi"(Label Info Error Label=$"Label Info Error Label", Label Info Missing Error=$"Label Info Missing Error", Error In=w29, Is Label Necessary?=TRUE) -> (Proceed to enqueue=w47, Error Out=w48)
        call "Condition Enqueue.gvi"(Queue In=s1, Queue Instruction="IV Curves Acquisition", Error In=w48, Equeue?=w47) -> (Queue Out=w32, Error Out=w49)
        call "JV Operation Translation.gvi"(Acquire Button=FALSE, Load Measurement=$"Load Measurement", Save Measurement=FALSE, Error In=w49) -> (Error Out=w31)
        w33 = default
      }
      on "Set Cell" Value changed {
        call "Set Cell Requisites.gvi"(Queue In=s1, Instrument Control Mega Cluster=$"Instrument Control Mega Cluster", Error In=w29, Set Cell=$"Set Cell") -> (Queue Out=w32, Error Out=w31)
        w33 = default
      }
      on "Cell Parameters" Value changed; "Cell Selector" Value changed; "JV Scan Mode" Value changed; "Measurement Precision" Value changed {
        call "Update Cluster Info Subroutine.gvi"(Misc Data Mega Cluster In=$"Misc Data Mega Cluster", JV Measurements Mega Cluster In=$"JV Measurements Mega Cluster", Error In=w29) -> (Misc Data Mega Cluster Out=w50, JV Measurements Mega Cluster Out=w51, Error Out=w31)
        $"Misc Data Mega Cluster" <- w50
        $"JV Measurements Mega Cluster" <- w51
        w32 = s1
        w33 = default
      }
      on "Add Layer Button" Value changed {
        call "Check Queue And Label.gvi"(Label Info Error Label=$"Label Info Error Label", Label Info Missing Error=$"Label Info Missing Error", Error In=w29, Is Label Necessary?=TRUE) -> (Proceed to enqueue=w52, Error Out=w53)
        call "Condition Enqueue.gvi"(Queue In=s1, Queue Instruction="Add Layer", Error In=w53, Equeue?=w52) -> (Queue Out=w32, Error Out=w31)
        w33 = default
      }
    }
    call "Is Error.gvi"(error in=w31) -> (error?=w54)
    Logical Or(w54, w33) -> w55
    next s1 = w32
    stop if w55
  }
  Enqueue Element(element="Stopping App", error in=w31, queue=s1) -> (error out=w56, queue out=w57)
  s2 = w30  # shift register
  s3 = w29  # shift register
  while {
    event (timeout = 100) {
      on "Timeout" {
        call "FGV Global Abort.gvi"(Global Abort Instructions="Read Current State", Error In=s3) -> (Global Abort Out=w61, Error Out=w62)
        Preview Queue Element(error in=w62, queue=s2, timeout in ms=100) -> (element=w63, error out=w58, queue out=w59)
        Is Equal(x=w63, y="Stopping App") -> w64
        Logical Or(w64, w61) -> w60
      }
      on "Abort Button" Value changed {
        call "Abort Sequence.gvi"(Queue In=s2, Global Abort=$"Abort Button", Error In=s3) -> (Queue Out=w59, Error Out=w58)
        w60 = default
      }
    }
    next s2 = w59
    next s3 = w58
    stop if w60
  }
  Enqueue Element(element="Stopping App", error in=s3, queue=s2) -> (error out=w65)
  s4 = w30  # shift register
  while {
    Dequeue Element(error in=w29, queue=s4) -> (element=w66, error out=w67, queue out=w68)
    case (w66) {
      frame "Undefined State", Default {
        w69 = w67
        w70 = w68
        w71 = default
      }
      frame "Debug Check" {
        call "Debugging Prompt.gvi"(Instrument Control Mega Cluster In=$"Instrument Control Mega Cluster", Error In=w67) -> (Instrument Control Mega Cluster Out=w72, Error Out=w73)
        Enqueue Element(element="Initialize App", error in=w73, queue=w68) -> (error out=w69, queue out=w70)
        $"Instrument Control Mega Cluster" <- w72
        w71 = default
      }
      frame "Initialize App" {
        call "Initialize App Subroutine.gvi"(Instrument Control Mega Cluster In=$"Instrument Control Mega Cluster", Misc Data Mega Cluster In=$"Misc Data Mega Cluster", Error In=w67) -> (Instrument Control Mega Cluster Out=w74, Misc Data Mega Cluster Out=w75, Error Out=w76)
        $"Instrument Control Mega Cluster" <- w74
        $"Misc Data Mega Cluster" <- w75
        Enqueue Element(element="Idle", error in=w76, queue=w68) -> (error out=w69, queue out=w70)
        w71 = default
      }
      frame "Idle" {
        call "FGV Global Abort.gvi"(Global Abort Instructions="Reset Local", Error In=w67) -> (Error Out=w77)
        call "FGV Current State.gvi"(Current State Instructions="Set Current State and Substate", Current State="Idle", Current Substate="Idle", Error In=w77) -> (Error Out=w78)
        call "FGV Progress.gvi"(FGV Instructions="Reset State", Error In=w78) -> (Error Out=w69)
        w70 = w68
        w71 = default
      }
      frame "Change Cell" {
        call "Set Cell Subroutine.gvi"(Instrument Control Mega Cluster In=$"Instrument Control Mega Cluster", Error In=w67) -> (Instrument Control Mega Cluster Out=w79, Error Out=w80)
        Enqueue Element(element="Idle", error in=w80, queue=w68) -> (error out=w69, queue out=w70)
        $"Instrument Control Mega Cluster" <- w79
        w71 = default
      }
      frame "IV Curves Acquisition" {
        call "Full JV Curve Measurement Subroutine.gvi"(Instrument Control Mega Cluster In=$"Instrument Control Mega Cluster", Misc Data Mega Cluster In=$"Misc Data Mega Cluster", JV Measurements Mega Cluster In=$"JV Measurements Mega Cluster", Error In=w67) -> (Instrument Control Mega Cluster Out=w81, Misc Data Mega Cluster Out=w82, JV Measurements Mega Cluster Out=w83, Error Out=w84)
        $"Instrument Control Mega Cluster" <- w81
        $"Misc Data Mega Cluster" <- w82
        Enqueue Element(element="Idle", error in=w84, queue=w68) -> (error out=w69, queue out=w70)
        $"JV Measurements Mega Cluster" <- w83
        w71 = default
      }
      frame "Add Layer" {
        call "New Layer Prompt.gvi"(Misc Data Mega Cluster In=$"Misc Data Mega Cluster", Error In=w67) -> (Misc Mega Cluster Data Out=w85, Error Out=w86)
        call "Layer String Array Generator.gvi"(Misc Data Mega Cluster In=w85, Error In=w86) -> (Misc Data Mega Cluster Out=w87, Layer String ID Array=w88, Error Out=w89)
        Enqueue Element(element="Idle", error in=w89, queue=w68) -> (error out=w69, queue out=w70)
        $"Misc Data Mega Cluster" <- w87
        $"Layer Information" <- w88
        w71 = default
      }
      frame "Stopping App" {
        call "FGV Current State.gvi"(Current State Instructions="Set Current State and Substate", Current State="Stopping App", Current Substate="Bye Bye :D", Error In=w67) -> (Error Out=w69)
        w70 = w68
        w71 = TRUE
      }
    }
    call "Is Error.gvi"(error in=w69) -> (error?=w90)
    Logical Or(w90, w71) -> w91
    call "FGV Global Abort.gvi"(Global Abort Instructions="Reset State", Global Abort=w91, Error In=w69) -> (Error Out=w92)
    next s4 = w70
    stop if w91
  }
  Enqueue Element(element="Stopping App", error in=w92, queue=s4) -> (error out=w93)
  call "Multiplex Errors.gvi"(error in 1=w56, error in 2=w93, error in 3=w65) -> (error out=w94)
  Flush Queue(error in=w94, queue=w57) -> (error out=w95, queue out=w96)
  Release Queue(error in=w95, queue=w96) -> (error out=w97)
  case (w97) {
    frame Error, Default {
      # In case there is an error
      # put out an error handler
      call "Display Error.gvi"(error in=w97)
    }
    frame No Error { }
  }
