vi "K2450 Sweep Subroutine.gvi"   [LabVIEW NXG 5.0.0]
inputs:
  "Error In": error
outputs:
  "Error Out": error
panel controls:
  "Instrument Control Mega Cluster In": "Instrument Control Mega Cluster.gtype"
  "IV Measurements Mega Cluster In": "IV Measurements Mega Cluster.gtype"
panel indicators:
  "Instrument Control Mega Cluster Out": "Instrument Control Mega Cluster.gtype"
types:
  T1 = cluster{"Element 1": "VISA Instr", "Element 2": string}
  T2 = enum{"Keithley 2400 Series", "Keithley 2450 Series"}
  "Instrument Control.gtype" = cluster{"Multiplexer Arduino Detected?": bool, "Multiplexer Arduino Address": "VISA Instr", "Arduinos List": T1[], "Multiplexer Log": string, "Keythley Address": "VISA Instr", "Keithley Detected?": bool, "Keithley ID": string, "Detected Keithley Type": T2}
  "Debugging Cluster.gtype" = cluster{"Debugging mode?": bool, "Initialize App": bool, "Insturment Debugging": cluster{"Keithley": bool, "Arduino": bool}}
  "Instrument Control Mega Cluster.gtype" = cluster{"Instrument Control": "Instrument Control.gtype", "Debugging Cluster": "Debugging Cluster.gtype"}
  "IV Mode.gtype" = enum{"Rough", "Normal", "Accurate", "Smart", "Custom"}
  "IV Curve Parameters.gtype" = cluster{"Cell Parameters": "Cell Parameters.gtype", "Measurement Precision": "Accuracy Parameters.gtype", "IV Accuracy Mode": "IV Mode.gtype"}
  T3 = cluster{"L.01": bool, "R.01": bool, "L.02": bool, "R.02": bool, "L.03": bool, "R.03": bool, "L.04": bool, "R.04": bool, "L.05": bool, "R.05": bool, "L.06": bool, "R.06": bool, "L.07": bool, "R.07": bool, "L.08": bool, "R.08": bool, "L.09": bool, "R.09": bool, "L.10": bool, "R.10": bool, "L.11": bool, "R.11": bool, "L.12": bool, "R.12": bool}
  "Cell Selector.gtype" = cluster{"All": bool, "Left": bool, "Right": bool, "Cell Cluster": T3, "Reset": bool, "Random Order ": bool, "Continuous Cell": bool}
  "IV Measurements Mega Cluster.gtype" = cluster{"IV Curve Parameters": "IV Curve Parameters.gtype", "Cell Selector": "Cell Selector.gtype"}
  "IV Measurement Data.gtype" = cluster{"Voltage (V)": f64[], "Current (A)": f64[], "Current Density (A/m^2)": f64[], "Dividing Wavelength (nm)": f64, "Light Power Density (W/m^2)": f64, "Total Light Power Density (W/m^2)": f64}
uses:
  Pika IV Characterization NXG::Main Functions::Instruction Handling::FGV Current State.gvi
  Labview_NXG_Keithley_SMU_2450_2460_2461::Configure::Clear Buffer.gvi
  Labview_NXG_Keithley_SMU_2450_2460_2461::Action Status::Enable Output.gvi
  Labview_NXG_Keithley_SMU_2450_2460_2461::Data::Low Level::Initiate.gvi
  Pika IV Characterization NXG::Side Functions::Instrument Control::Keithley::FGV Keithley Timeout.gvi
  Labview_NXG_Keithley_SMU_2450_2460_2461::Data::Low Level::Wait for Operation Complete.gvi
  Labview_NXG_Keithley_SMU_2450_2460_2461::Data::Read (Multiple Points).gvi
  Pika IV Characterization NXG::Side Functions::Instrument Control::Keithley::Keithley Timeout Check.gvi
  NI::VISA::Write (Instr, String).gvi
diagram:
  case ($"Error In") {
    frame Error, Default {
      w1 = $"Error In"
      w2 = _
    }
    frame No Error {
      Property Node(instance in=$"IV Measurements Mega Cluster In") -> ("IV Curve Parameters:IV Accuracy Mode"=w3, instance out=w4)
      Is Not Equal(x=w3, y="Smart") -> w5
      case (w5) {
        frame False, Default {
          w2 = $"Instrument Control Mega Cluster In"
        }
        frame True {
          Property Node(instance in=w4) -> ("IV Curve Parameters:Measurement Precision:V Points"=w6)
          # Clears all event registers and Error Queue
          Property Node(instance in=$"Instrument Control Mega Cluster In") -> ("Instrument Control:Keythley Address"=w7, instance out=w8)
          call "FGV Current State.gvi"(Current State Instructions="Set Current Substate", Current Substate="Sweeping Keithley", Error In=$"Error In") -> (Error Out=w9)
          call "Clear Buffer.gvi"(VISA resource name=w7, error in (no error)=w9) -> (VISA resource name out=w10, error out=w11)
          call "Enable Output.gvi"(VISA resource name=w10, Enable Output (T: Enable)=TRUE, error in (no error)=w11) -> (VISA resource name out=w12, error out=w13)
          call "Initiate.gvi"(VISA resource name=w12, error in (no error)=w13) -> (VISA resource name out=w14, error out=w15)
          call "FGV Keithley Timeout.gvi"(FGV Instructions="Read State", Error In=w15) -> (Timeout in ms Out=w16, Error Out=w17)
          call "Wait for Operation Complete.gvi"(VISA resource name=w14, Timeout (10000 ms)=w16, error in (no error)=w17) -> (VISA resource name out=w18, error out=w19)
          call "Read (Multiple Points).gvi"(VISA resource name=w18, Start Index (1)=1, End Index (1)=w6, error in (no error)=w19, Buffer Elements="SOUR, READ") -> (VISA resource name out=w20, Data out=w21, error out=w22)
          Spreadsheet String To Array(array type=f64[] [], delimiter=",", format string="%s", spreadsheet string=w21) -> (array=w23)
          Decimate Array(array=w23) -> (out0=w24, out1=w25)
          Property Node(instance in="IV Measurement Data.gtype" {all zero or empty}, "Voltage (V)"=w24, "Current (A)"=w25)
          call "Keithley Timeout Check.gvi"(Error In=w22) -> (Error Out=w26)
          call "Enable Output.gvi"(VISA resource name=w20, Enable Output (T: Enable)=FALSE, error in (no error)=w26) -> (VISA resource name out=w27, error out=w28)
          call "Write (Instr, String).gvi"(session in=w27, error in=w28, write buffer="*CLS;") -> (session out=w29)
          Property Node(instance in=w8, "Instrument Control:Keythley Address"=w29) -> (instance out=w2)
        }
      }
      w1 = _
    }
  }
  $"Instrument Control Mega Cluster Out" <- w2
  $"Error Out" <- w1
