vi "Random IV Curve Generator.gvi"   [LabVIEW NXG 5.0.0]
inputs:
  "Error In": error
  "IV Measurement Mega Cluster In": "IV Measurements Mega Cluster.gtype"
  "Intensity Constant": f64
  "Light Intensity": f64
outputs:
  "Error Out": error
  "Voltage": f64[]
  "Current": f64[]
types:
  "IV Mode.gtype" = enum{"Rough", "Normal", "Accurate", "Smart", "Custom"}
  "IV Curve Parameters.gtype" = cluster{"Cell Parameters": "Cell Parameters.gtype", "Measurement Precision": "Accuracy Parameters.gtype", "IV Accuracy Mode": "IV Mode.gtype"}
  T1 = cluster{"L.01": bool, "R.01": bool, "L.02": bool, "R.02": bool, "L.03": bool, "R.03": bool, "L.04": bool, "R.04": bool, "L.05": bool, "R.05": bool, "L.06": bool, "R.06": bool, "L.07": bool, "R.07": bool, "L.08": bool, "R.08": bool, "L.09": bool, "R.09": bool, "L.10": bool, "R.10": bool, "L.11": bool, "R.11": bool, "L.12": bool, "R.12": bool}
  "Cell Selector.gtype" = cluster{"All": bool, "Left": bool, "Right": bool, "Cell Cluster": T1, "Reset": bool, "Random Order ": bool, "Continuous Cell": bool}
  "IV Measurements Mega Cluster.gtype" = cluster{"IV Curve Parameters": "IV Curve Parameters.gtype", "Cell Selector": "Cell Selector.gtype"}
uses:
  Pika IV Characterization NXG::Side Functions::Instrument Control::Keithley::Keithley Sweep Parameter Calculator.gvi
  NI::G Core::Numeric::Random Number (Range) DBL.gvi
diagram:
  case ($"Error In") {
    frame Error, Default {
      w1 = $"Error In"
      w2 = f64[] []
      w3 = f64[] []
    }
    frame No Error {
      call "Keithley Sweep Parameter Calculator.gvi"(IV Measurements Mega Cluster In=$"IV Measurement Mega Cluster In", Error In=$"Error In") -> (Sweep Points=w4, Error Out=w1)
      Property Node(instance in=w4) -> ("Start "=w5, "Stop "=w6, "Number of Points (5)"=w7)
      call "Random Number (Range) DBL.gvi"(upper bound=1.2, lower bound=0.8) -> (number=w8)
      Multiply(w8, $"Light Intensity") -> w9
      Multiply($"Intensity Constant", w8) -> w10
      To Signed 32 Bit Integer(number=w7) -> w11
      Subtract(x=w6, y=w5) -> w12
      To Double Precision Float(number=w7) -> w13
      Divide(x=w12, y=w13) -> w14
      for (N = w11) (iteration -> i1) {
        To Double Precision Float(number=i1) -> w15
        Multiply(w14, w15) -> w16
        Add(w5, w16) -> w17
        To Double Precision Float(number=w17) -> w18
        Exponential(x=w17) -> w19
        Multiply(w19, w10) -> w20
        Add(w9, w20) -> w21
        append w18 to w2
        append w21 to w3
      }
    }
  }
  $Voltage <- w2
  $Current <- w3
  $"Error Out" <- w1
