vi "FGV Sample Prefix.gvi"   [LabVIEW NXG 5.0.0]
inputs:
  "FGV Instructions": "FGV Instructions.gtype" = "Read State", required
  "Error In": error
  "Misc Mega Cluster": "Misc Mega Cluster.gtype"
outputs:
  "Error Out": error
  "Sample Prefix Out": string
types:
  "FGV Instructions.gtype" = enum{"Read State", "Set State", "Reset State"}
  "Full Reference Cluster.gtype" = cluster{"Sample Extra Information": "Sample extra imformation.gtype", "Acquisition Parameters": "Acquisition Parameters.gtype", "Status Report": "Status Report.gtype", "Live Progress": "Live Progress.gtype", "Sample Naming Cluster": "Sample Naming Cluster.gtype"}
  "Misc Mega Cluster.gtype" = cluster{"Full Reference Cluster": "Full Reference Cluster.gtype"}
diagram:
  # This FGV Stores the Sample Prefix Info so that it can be easily
  # accessed from anywhere within the code
  case ($"Error In") {
    frame Error, Default {
      w1 = $"Error In"
    }
    frame No Error {
      s1 = $"Error In"  # shift register
      s2 = uninitialised  # shift register
      while {
        case ($"FGV Instructions") {
          frame "Read State", Default {
            $"Sample Prefix Out" <- s2
            w2 = s1
            w3 = s2
          }
          frame "Set State" {
            Property Node(instance in=$"Misc Mega Cluster") -> ("Full Reference Cluster:Sample Naming Cluster:Sample Prefix"=w4)
            Property Node(instance in=w4, error in=s1) -> ("Value"=w3, error out=w2)
          }
          frame "Reset State" {
            w2 = s1
            w3 = default
          }
        }
        next s1 = w2
        next s2 = w3
        stop if TRUE
      }
      w1 = s1
    }
  }
  $"Error Out" <- w1
