vi "Sample Naming Subroutine.gvi"   [LabVIEW NXG 5.0.0]
inputs:
  "Error In": error
  "Misc Data Mega Cluster In": "Misc Mega Cluster.gtype"
outputs:
  "Error Out": error
  "Misc Data Mega Cluster Out": "Misc Mega Cluster.gtype"
types:
  "Full Reference Cluster.gtype" = cluster{"Status Report": "Status Report.gtype", "Path Cluster": "Path Cluster.gtype", "Sample Naming Cluster": "Sample Naming Cluster.gtype", "Acquisition Parameters": "Acquisition Parameters.gtype", "Live Progress Cluster": "Live Progress.gtype", "Sample Extra Information": "Sample extra imformation.gtype"}
  "Misc Mega Cluster.gtype" = cluster{"Full Reference Cluster": "Full Reference Cluster.gtype"}
uses:
  Pika IV Characterization NXG::Side Functions::Utilities::Time::Get Date YYMMDD.gvi
  Pika IV Characterization NXG::Side Functions::Utilities::Cell Naming::Prefix Generator.gvi
diagram:
  # This SubVI Takes the data from the Sample Naming Variables and it generates the prefix so that the files can be propperly saved
  case ($"Error In") {
    frame Error, Default {
      w1 = $"Error In"
      w2 = $"Misc Data Mega Cluster In"
    }
    frame No Error {
      Property Node(instance in=$"Misc Data Mega Cluster In") -> ("Full Reference Cluster:Sample Naming Cluster:Custom Date"=w3, "Full Reference Cluster:Sample Naming Cluster:Current Date"=w4, instance out=w5)
      Property Node(instance in=w4, error in=$"Error In") -> ("Value"=w6, error out=w7, instance out=w8)
      Property Node(instance in=w3, error in=w7) -> ("Value"=w9, error out=w10)
      case (w9) {
        frame True {
          Property Node(instance in=w8, "Disabled"=FALSE, error in=w10) -> (error out=w12, instance out=w13)
          w11 = w6
        }
        frame False {
          Property Node(instance in=w8, "Disabled"=TRUE, error in=w10) -> (error out=w14, instance out=w13)
          call "Get Date YYMMDD.gvi"(Error In=w14) -> (Date YYMMDD=w11, Error Out=w12)
        }
      }
      Property Node(instance in=w5) -> ("Full Reference Cluster:Acquisition Parameters:Cell Selector Ref"=w15, "Full Reference Cluster:Sample Naming Cluster:Cell Number"=w16, instance out=w17)
      Property Node(instance in=w13, "Value"=w11, error in=w12) -> (error out=w18)
      Property Node(instance in=w15, error in=w18) -> ("Value"=w19, error out=w20)
      Property Node(instance in=w19) -> ("No Multiplexer"=w21)
      Property Node(instance in=w16, error in=w20) -> ("Value"=w22, error out=w23, instance out=w24)
      case (w21) {
        frame False, Default {
          Property Node(instance in=w24, "Disabled"=TRUE, error in=w23) -> (error out=w27)
          w25 = ""
          w26 = FALSE
        }
        frame True {
          Property Node(instance in=w24, "Disabled"=FALSE, error in=w23) -> (error out=w27)
          w25 = w22
          w26 = TRUE
        }
      }
      call "Prefix Generator.gvi"(Misc Data Mega Cluster In=w17, Current Date=w11, Cell Number=w25, Error In=w27, Cell number required?=w26) -> (Misc Data Mega Cluster Out=w2, Error Out=w1)
    }
  }
  $"Misc Data Mega Cluster Out" <- w2
  $"Error Out" <- w1
